# Grasshopper definition Infinite-Spiral.gh (Grasshopper 1.0.7)
# plug-ins: GhPolyhedra, Kangaroo2 Components, LunchBox, V-Ray For Grasshopper 6

number_slider = Slider(300, range=0..1000)
timeline = VRayTimeline(FramesCount=number_slider, RangeStart=Slider(155, range=0..1000), RangeEnd=Slider(299, range=0..1000))  # -> Timeline, CurrentFrame, CurrentFraction
helicoid = HelicoidSurface(
    UDivisions=100,
    VDivisions=100,
    RParameter=Slider(4, range=0..10),
    TParameter=Slider(2, range=0..10),
    Scale=5,
    Domain1=Domain(-6.283185307, 6.283185307),
    Domain2=Domain(-3.141592654, 3.141592654))
number_slider_2 = Slider(5.7, range=0..10)
srf = Surface(helicoid)
triremesh = TriRemesh(Geometry=srf, Length=Slider(6, range=0..10), Iterations=Slider(50, range=0..50))  # -> Triangulation, Dual, Creases
waterman = Waterman(Plane=PlaneXY(0, 0, 0), Root=Slider(76, range=0..100))  # -> Curves, Mesh
mesh = Mesh(triremesh.Triangulation)
md_slider = MDSlider(SliderMode=0, slider_value=Point(0.5, 0.5, 0.5), x_domain=Domain(0, 1), y_domain=Domain(0, 1), z_domain=Domain(0, 1))
preview = CustomPreview(Geometry=waterman.Mesh, Material=ColourSwatch(SwatchColor=RGB(217, 13, 13)))
faceb = FaceBoundaries(Mesh=mesh)
graft = GraftTree(Tree=faceb, IncludeEmptyLists=True, IncludeNullItems=True)
number_slider_3 = Slider(0.3, range=0..1)
fillet = Fillet(Curve=graft, Radius=Slider(0.4, range=0..10))
subtraction = Subtraction(A="1", B=number_slider_3)
boundary = BoundarySurfaces(Edges=fillet)  # -> graft(Surfaces)
area = Area(Geometry=boundary)  # -> Area, Centroid
pdecon = Deconstruct(Point=area.Centroid)  # -> XComponent, YComponent, ZComponent
dom = ConstructDomain(DomainStart=number_slider_3, DomainEnd=subtraction)
bnd = Bounds(Numbers=flatten(pdecon.ZComponent))
remap = RemapNumbers(Value=timeline.CurrentFrame, Source=number_slider, Target=dom)  # -> Mapped, Clipped
scale = Scale(Geometry=fillet, Center=area.Centroid, Factor=Slider(0.95, range=0..1))  # -> Geometry, Transform
evalsrf = EvaluateSurface(Surface=reparameterize(boundary), Point=md_slider)  # -> Point, Normal, UDirection, VDirection, Frame
remap_2 = RemapNumbers(Value=pdecon.ZComponent, Source=bnd, Target=Domain(0, 1))  # -> Mapped, Clipped
panel = Panel(remap.Mapped)
subtraction_2 = Subtraction(A=remap_2.Mapped, B=remap.Mapped)
reb = RebuildCurve(Curve=scale.Geometry, Count=Slider(100, range=0..1000), Tangents=False)
abs = Absolute(Value=subtraction_2)
bnd_2 = Bounds(Numbers=flatten(abs))
graph = GraphMapper(
    abs,
    x0=0,
    x1=1,
    y0=0,
    y1=1,
    container_name="Bezier2",
    pt=[Point(0, 0.8642207384, 0), Point(0.1947546899, 0.7195725441, 0), Point(0.3095897138, 0.6358617544, 0), Point(0.4282517731, 0.6278892756, 0), Point(0.6920473918, 0.6101657925, 0), Point(0.8225162625, 0.6039719582, 0), Point(1, 0.631875515, 0)])
remap_3 = RemapNumbers(Value=abs, Source=bnd_2, Target=Domain(0, 1))  # -> Mapped, Clipped
panel_2 = Panel(bnd_2)
graph_2 = GraphMapper(
    abs,
    x0=0,
    x1=1,
    y0=0,
    y1=1,
    container_name="Bezier2",
    pt=[Point(0, 0.8642207384, 0), Point(0.06126051769, 0.4498282671, 0), Point(0.159043034, 0.310016112, 0), Point(0.3204012811, 0.3075683713, 0), Point(0.5437182486, 0.3041807413, 0), Point(0.5952557921, 0.3075683713, 0), Point(1, 0.3041806817, 0)])
multiplication = Multiplication(A=graph, B=Slider(0.9, range=0..1))
multiplication_2 = Multiplication(A=graph, B=Slider(0.12, range=0..1))
amp = Amplitude(Vector=evalsrf.Normal, Amplitude=multiplication_2)
amp_2 = Amplitude(Vector=evalsrf.Normal, Amplitude=multiplication_2)
amp_3 = Amplitude(Vector=evalsrf.Normal, Amplitude=multiplication)
scale_2 = Scale(Geometry=fillet, Center=evalsrf.Point, Factor=graph_2)  # -> Geometry, Transform
amp_4 = Amplitude(Vector=evalsrf.Normal, Amplitude=multiplication)
neg = Negative(Value=amp)
neg_2 = Negative(Value=amp_3)
move = Move(Geometry=reb, Motion=amp_2)  # -> Geometry, Transform
move_2 = Move(Geometry=reb, Motion=neg)  # -> Geometry, Transform
move_3 = Move(Geometry=scale_2.Geometry, Motion=neg_2)  # -> Geometry, Transform
move_4 = Move(Geometry=scale_2.Geometry, Motion=amp_4)  # -> Geometry, Transform
merge = Merge(Data1=move_4.Geometry, Data2=move.Geometry, Data3=move_2.Geometry, Data4=move_3.Geometry)
merge_2 = Merge(Data1=move.Geometry, Data2=move_2.Geometry, Data3=move_3.Geometry, Data4=move_4.Geometry)  # -> simplify(Result)
merge_3 = Merge(Data1=move.Geometry, Data2=move_4.Geometry)  # -> simplify(Result)
loft_opt = LoftOptions(Closed=Toggle(False), Adjust=False, Rebuild=0, Refit=0, Type=Slider(3, range=0..10))
loft = Loft(Options={Adjust=False, Closed=False, LoftEnds=0, LoftSimp=0, LoftType=0, Rebuild=10, Refit=0.01})
loft_2 = Loft(Curves=merge_2, Options=loft_opt)
loft_3 = Loft(Curves=merge_3, Options={Adjust=False, Closed=False, LoftEnds=0, LoftSimp=0, LoftType=0, Rebuild=10, Refit=0.01})
mtl_simple = VRayMaterialSimple(
    Diffuse=ColourSwatch(SwatchColor=RGB(28, 28, 28)),
    Reflection=ColourSwatch(SwatchColor=RGB(199, 199, 199)),
    Glossiness=Slider(1, range=0..1),
    IOR=1.3,
    Opacity=1,
    Emission=RGB(0, 0, 0))
mtl_simple_2 = VRayMaterialSimple(
    Diffuse=ColourSwatch(SwatchColor=RGB(242, 242, 242)),
    Reflection=ColourSwatch(SwatchColor=RGB(255, 255, 255)),
    Glossiness=Slider(1, range=0..10),
    IOR=1.3,
    Opacity=1,
    Emission=RGB(0, 0, 0))
vgeo = VRayGeometry(Geo=flatten(loft_3), Material=mtl_simple_2)
vgeo_2 = VRayGeometry(Geo=flatten(loft_2), Material=mtl_simple)
merge_4 = Merge(Data1=vgeo, Data2=vgeo_2)
pi = Pi(Factor=Slider(3.76, range=0..10))
addition = Addition(B=pi)
number_slider_4 = Slider(0, range=0..100)
number_slider_5 = Slider(110, range=0..1000)
remap_4 = RemapNumbers(Value=timeline.CurrentFrame, Source=number_slider, Target=Slider(2, range=0..10))  # -> Mapped, Clipped
addition_2 = Addition(A=remap_4.Mapped, B=Slider(3.49, range=0..10))
cos = Cosine(Value=addition)
sin = Sine(Value=addition)
pi_2 = Pi(Factor=addition_2)
number_slider_6 = Slider(0, range=-100..100)
number_slider_7 = Slider(0, range=0..100)
number_slider_8 = Slider(0, range=0..100)
multiplication_3 = Multiplication(A=number_slider_5, B=cos)
multiplication_4 = Multiplication(A=sin, B=number_slider_5)
addition_3 = Addition(B=pi_2)
neg_3 = Negative(Value=multiplication_4)
neg_4 = Negative(Value=number_slider_4)
neg_5 = Negative(Value=multiplication_3)
number_slider_9 = Slider(50, range=0..1000)
cos_2 = Cosine(Value=addition_3)
sin_2 = Sine(Value=addition_3)
pt = ConstructPoint(XCoordinate=multiplication_3, YCoordinate=multiplication_4, ZCoordinate=number_slider_4)
mtl_file_path = VRayMaterialFromFile(
    "D:\Rhino_Grass\Spi\Plastic_03.vismat",
    File_Picker=0,
    File_Types="V-Ray materials (*.vrmat;*.vismat)|*.vrmat;*.vismat",
    Has_Extract_Parameter=True,
    Has_Manage_Collection=True,
    Has_Multiple_Files_Menu=False,
    Has_Picker_File_Menu=False,
    Multiple_Files=False)
pt_2 = ConstructPoint(XCoordinate=neg_5, YCoordinate=multiplication_4, ZCoordinate=neg_4)
multiplication_5 = Multiplication(A=sin_2, B=number_slider_9)
multiplication_6 = Multiplication(A=number_slider_9, B=cos_2)
multiplication_7 = Multiplication(A=sin_2, B=number_slider_7)
multiplication_8 = Multiplication(A=number_slider_7, B=cos_2)
number_slider_10 = Slider(100, range=0..1000)
pt_3 = ConstructPoint(XCoordinate=multiplication_8, YCoordinate=multiplication_7, ZCoordinate=number_slider_6)
pt_4 = ConstructPoint(XCoordinate=multiplication_6, YCoordinate=multiplication_5, ZCoordinate=number_slider_6)
number_slider_11 = Slider(200, range=0..1000)
sampler = Sampler(1, Has_Extract_Parameter=False, Has_Manage_Collection=False, OptionsLength=2, Options=["Progressive", "Bucket"])
save_file = OutputImage(
    "D:\Rhino_Grass\Spi\S.jpg",
    File_Picker=1,
    File_Types="Portable Network Graphics (*.png)|*.png|Windows bitmap (*.bmp)|*.bmp|Targa Image (*.tga)|*.tga|Radiance High-Dynamyc Range (*.hdr)|*.hdr|Silicon Graphics (*.sgi; *.rgb; *.rgba)|*.dgi;*.rgb;*.rgba|JPEG image (*.jpg; *.jpeg)|*.jpg;*.jpeg|OpenEXR image (*.exr)|*.exr|SoftImage PICT (*.pic)|*.pic|Tagged image (*.tif; *.tiff)|*.tif;*.tiff|V-Ray Raw Image (*.vrimg)|*.vrimg",
    Has_Extract_Parameter=False,
    Has_Manage_Collection=True,
    Has_Multiple_Files_Menu=False,
    Has_Picker_File_Menu=False,
    Multiple_Files=False)
quality = Quality(
    3,
    Has_Extract_Parameter=False,
    Has_Manage_Collection=False,
    OptionsLength=5,
    Options=["Draft", "Low", "Medium", "High", "Very High"])
engine = Engine(1, Has_Extract_Parameter=False, Has_Manage_Collection=False, OptionsLength=2, Options=["CPU", "GPU"])
mode = Mode(1, Has_Extract_Parameter=False, Has_Manage_Collection=False, OptionsLength=2, Options=["Interactive", "Production"])
light_rectangle = VRayLightRectangle(
    On=True,
    Position=pt,
    Target=Point(0, 0, 0),
    Color=RGB(255, 255, 255),
    Intensity=Slider(1, range=0..10),
    Invisible=True,
    Size=number_slider_10)
light_rectangle_2 = VRayLightRectangle(
    On=True,
    Position=pt_2,
    Target=Point(0, 0, 0),
    Color=RGB(255, 255, 255),
    Intensity=Slider(1, range=0..10),
    Invisible=True,
    Size=number_slider_10)
camera = VRayCamera(
    Position=pt_4,
    Target=pt_3,
    FOV=Slider(60, range=0..100),
    PhysicalExposureOn=Toggle(False),
    FNumber=8,
    ShutterSpeed1S=100,
    FilmSensitivity=625)  # -> Camera, Angle
rig_simple = VRayLightRigSimple(
    GradientOn=True,
    ReflectEnvironmentOn=True,
    GIOn=True,
    GIEnvironmentColor=RGB(204, 229, 255),
    LightOn=True,
    LightColor=RGB(255, 255, 255),
    LightAngle=0,
    LightIntensity=Slider(1, range=0..1),
    AdditionalLights=[light_rectangle, light_rectangle_2])
render = VRayRender(
    Engine=engine,
    Mode=mode,
    Sampler=sampler,
    Quality=quality,
    OutputImage=save_file,
    OutputResolution=[800, 800],
    Camera=camera.Camera,
    LightRig=rig_simple,
    VGeometry=flatten(merge_4),
    Timeline=timeline.Timeline)
